# Grasshopper definition topoSpeckle.ghx (Grasshopper 1.0.7)
# plug-ins: Speckle 2

mesh = GetGeometry(AtLeast=1, AtMost=2147483647, DeleteInput=False, Filter=1074004029, TreeAccess=True)
python = GhPythonScript()  # -> out
# ---------- python: Python ----------
__author__ = "RivinduB"
__version__ = "2023.08.03"

import rhinoscriptsyntax as rs
import Rhino

my_doc = Rhino.RhinoDoc.CreateHeadless(None)
my_doc.ModelUnitSystem = Rhino.UnitSystem.Meters
Rhino.RhinoDoc.ActiveDoc = my_doc
# ---------- end python ----------
revittopography = RevitTopography(
    DisplayMesh=mesh,
    SelectedConstructorName="Objects.BuiltElements.Revit.RevitTopography.ctor(Objects.Geometry.Mesh,System.Collections.Generic.List`1[Objects.BuiltElements.Revit.Parameter])",
    SelectedTypeName="Objects.BuiltElements.Revit.RevitTopography",
    UseSchemaTag=False,
    UserSetSchemaTag=False,
    seed="1a35f28e0ab8cd1c6664")
to_speckle = ToSpeckle(Data=flatten(revittopography), preprocessGeometry=False, selectedKitName="Objects")
ss = SynchronousSender(
    Data=to_speckle,
    Stream="https://speckle.xyz/streams/dfa9f20f5f",
    OutputWrappers="https://speckle.xyz\t6928d0bb9a\t165eb6dcd1",
    UseDefaultCache=True,
    selectedKitName="Objects")

# ---- group: RH_OUT:Stream
txt = Text(ss)
